% Simulink data dictionary CorleyLorenz1998_HFI.sldd

TsHfi = 2.5e-5
TsSingle = single(2.5e-5)
CarrierStep = single(0.314159274)
InvCarrierOmega = single(7.95774686e-5)
TwoPi = single(6.28318548)
Vnom = single(4)
Rstator = single(0.24)
Ld = single(0.00045)
Lq = single(0.0008)
FluxPm = single(0.013)
PolePairs = single(2)
Inertia = single(0.0014)
LqOverLd = single(1.77777779)
LdOverLq = single(0.5625)
Vdc = single(48)
BpfB = single([0.153815016 0 -0.153815016])
BpfA = single([1 -1.60953951 0.692369938])
LpfB = single(0.0400179625)
LpfA = single([1 -0.959982038])
ErrorScale = single(6.46270466)
ObsP = single(339.292)
ObsV = single(38373.0234)
ObsL = single(1446628.88)
ThetaHatInitial = single(0.436332315)